# Grasshopper definition Parametric Modelling Coursework - Coca-Cola Tower.gh (Grasshopper 1.0.7)
# plug-ins: LunchBox

# ---- group: Tower 1 - Original Shape Copy
graph_mapper = GraphMapper(
    x0=0,
    x1=1,
    y0=0,
    y1=1,
    container_name="Sinc",
    Equation_X0=0.2343644649,
    Equation_X1=0.9934723377,
    Equation_Y0=0.6256872416,
    Equation_Y1=0.1818160415)

# ---- group: Tower 2 - Original Shape Copy
graph_mapper_2 = GraphMapper(x0=0, x1=1, y0=0, y1=1, Ox=0.5611510873, Oy=0.4222221971, Px=0.992805779, Py=0.592592597, container_name="Parabola")

# ---- group: Site Footprint
construct_domain = ConstructDomain(DomainStart=Slider(-40, range=-40..40), DomainEnd=Slider(40, range=-40..40))
construct_domain_2 = ConstructDomain(DomainStart=Slider(-30, range=-30..30), DomainEnd=Slider(30, range=-30..30))
colour_picker = ColourPicker(PickedColour=RGB(35, 35, 217))
rectangle = Rectangle(Plane=PlaneXY(0, 0, 0), XSize=construct_domain_2, YSize=construct_domain, Radius=0)  # -> Rectangle, Length
custom_preview = CustomPreview(Geometry=rectangle.Rectangle, Material=colour_picker)

# ---- group: Tower 1: Coca-Cola Tower / Building Shape - Tower 1
radius_prescaled_not_output = Slider(30, range=10..50)
no_of_slab_sides = Slider(7, range=0..10)
ground_floor_to_ceiling_height = Slider(7.4, range=5..10)
floor_to_floor_heights = Slider(4.2, range=3.5..5)
no_of_floors_excl_ground_floor = Slider(52, range=30..60)
series = Series(Start=ground_floor_to_ceiling_height, Step=floor_to_floor_heights, Count=no_of_floors_excl_ground_floor)
floor_height = Panel(series)
polygon = Polygon(Plane=PlaneXY(0, 0, 0), Radius=radius_prescaled_not_output, Segments=no_of_slab_sides, FilletRadius=0)  # -> Polygon, Length
polygon_2 = Polygon(Plane=PlaneXY(0, 0, 0), Radius=radius_prescaled_not_output, Segments=no_of_slab_sides, FilletRadius=0)  # -> Polygon, Length
rotation_angle = Slider(7.2, range=0..10)
unit_z = UnitZ(Factor=series)
bounds = Bounds(Numbers=floor_height)
move = Move(Geometry=polygon_2.Polygon, Motion=unit_z)  # -> Geometry, Transform
construct_point = ConstructPoint(XCoordinate=0, YCoordinate=0, ZCoordinate=0)
construct_point_2 = ConstructPoint(XCoordinate=0, YCoordinate=0, ZCoordinate=0)
unit_z_2 = UnitZ(Factor=0)
list_length = ListLength(List=floor_height)  # -> expr("x-1", Length)
series_2 = Series(Start=15, Step=rotation_angle, Count=no_of_floors_excl_ground_floor)
deconstruct_domain = DeconstructDomain(Domain=bounds)  # -> Start, End
bounds_2 = Bounds(Numbers=series_2)
move_2 = Move(Geometry=construct_point_2, Motion=unit_z_2)  # -> Geometry, Transform
move_3 = Move(Geometry=construct_point, Motion=unit_z)  # -> Geometry, Transform
rotate = Rotate(Geometry=move.Geometry, Angle=degrees(series_2), Plane=PlaneXY(0, 0, 0))  # -> Geometry, Transform
remap_numbers = RemapNumbers(Value=series_2, Source=bounds_2, Target=Domain(0, 1))  # -> Mapped, Clipped
graph_mapper_3 = GraphMapper(
    remap_numbers.Mapped,
    x0=0,
    x1=1,
    y0=0,
    y1=1,
    container_name="Sinc",
    Equation_X0=0.2343644649,
    Equation_X1=0.9934723377,
    Equation_Y0=0.6256872416,
    Equation_Y1=0.1818160415)
merge = Merge(Data1=polygon.Polygon, Data2=rotate.Geometry)  # -> flatten(Result)
merge_2 = Merge(Data1=move_2.Geometry, Data2=move_3.Geometry)  # -> flatten(Result)
floor_size_scale_factor = Panel(graph_mapper_3)
scale = Scale(Geometry=merge, Center=merge_2, Factor=graph_mapper_3)  # -> Geometry, Transform
multiplication = Multiplication(A=floor_size_scale_factor, B=radius_prescaled_not_output)
actual_radius_at_each_floor = Panel(multiplication)
bounds_3 = Bounds(Numbers=actual_radius_at_each_floor)
deconstruct_domain_2 = DeconstructDomain(Domain=bounds_3)  # -> Start, End

# ---- group: Tower 1: Coca-Cola Tower / Building Location
x_coordinate = Slider(30, range=-30..30)
y_coordinate = Slider(40, range=-40..40)
ghpython_script = GhPythonScript(x=x_coordinate, y=deconstruct_domain_2.End)  # -> out, a
# ---------- ghpython_script: Python ----------
__author__ = "jeffw"
__version__ = "2022.01.05"

import rhinoscriptsyntax as rs

if x+y>30:
    a = 30-y
elif x-y<-30:
    a = -30+y
else:
    a = x

print(a)
# ---------- end ghpython_script ----------
ghpython_script_2 = GhPythonScript(x=y_coordinate, y=deconstruct_domain_2.End)  # -> out, a
# ---------- ghpython_script_2: Python ----------
__author__ = "jeffw"
__version__ = "2022.01.05"

import rhinoscriptsyntax as rs

if x+y>40:
    a = 40-y
elif x-y<-40:
    a = -40+y
else:
    a = x

print(a)
# ---------- end ghpython_script_2 ----------
vector_xyz = VectorXYZ(XComponent=ghpython_script.a, YComponent=ghpython_script_2.a, ZComponent=0)  # -> Vector, Length

# ---- group: Tower 1: Coca-Cola Tower / Building Shape - Tower 1 (continued)
move_4 = Move(Geometry=scale.Geometry, Motion=vector_xyz.Vector)  # -> Geometry, Transform

# ---- group: Tower 1: Coca-Cola Tower / Bracing
explode = Explode(Curve=move_4.Geometry, Recursive=True)  # -> Segments, Vertices
series_3 = Series(Start=0, Step=1, Count=expr("x+1", no_of_floors_excl_ground_floor))  # -> graft(Series)
series_4 = Series(Start=0, Step=-1, Count=expr("x+1", no_of_floors_excl_ground_floor))  # -> graft(Series)
flip_matrix = FlipMatrix(Data=explode.Vertices)
shift_list = ShiftList(List=explode.Vertices, Shift=series_4, Wrap=True)
shift_list_2 = ShiftList(List=explode.Vertices, Shift=series_3, Wrap=True)
polyline = PolyLine(Vertices=flip_matrix, Closed=False)
flip_matrix_2 = FlipMatrix(Data=shift_list_2)
flip_matrix_3 = FlipMatrix(Data=shift_list)
pipe_radius = Slider(0.2, range=0..1)
bracing_radius = Slider(0.03, range=0..0.3)
polyline_2 = PolyLine(Vertices=flip_matrix_2, Closed=False)
polyline_3 = PolyLine(Vertices=flip_matrix_3, Closed=False)
pipe = Pipe(Curve=polyline, Radius=pipe_radius, Caps=2)
pipe_2 = Pipe(Curve=polyline_2, Radius=bracing_radius, Caps=2)
pipe_3 = Pipe(Curve=polyline_3, Radius=bracing_radius, Caps=2)
colour_picker_2 = ColourPicker(PickedColour=RGB(3, 17, 87))
custom_preview_2 = CustomPreview(Geometry=pipe, Material=colour_picker_2)
custom_preview_3 = CustomPreview(Geometry=pipe_3, Material=colour_picker_2)
custom_preview_4 = CustomPreview(Geometry=pipe_2, Material=colour_picker_2)

# ---- group: Tower 1: Coca-Cola Tower / Facade
facade_radius = Slider(0.5, range=0..1)
no_of_segment = Slider(3, range=0..10)
polygon_3 = Polygon(Plane=flip_matrix, Radius=facade_radius, Segments=no_of_segment, FilletRadius=0)  # -> Polygon, Length
loft = Loft(
    Curves=polygon_3.Polygon,
    Options={Adjust=False, Closed=False, LoftEnds=0, LoftSimp=0, LoftType=0, Rebuild=10, Refit=0.01})
colour_picker_3 = ColourPicker(PickedColour=RGB(242, 242, 242))
custom_preview_5 = CustomPreview(Geometry=loft, Material=colour_picker_3)

# ---- group: Tower 1: Coca-Cola Tower / Glass Panel
glass_panel_thickness = Slider(0.02, range=0..0.02)
unit_x = UnitX(Factor=glass_panel_thickness)
loft_2 = Loft(Curves=move_4.Geometry, Options={Adjust=False, Closed=False, LoftEnds=0, LoftSimp=0, LoftType=0, Rebuild=10, Refit=0.01})
opacity = Slider(24, range=0..250)
extrude = Extrude(Base=loft_2, Direction=unit_x)
colour_rgb = ColourRGB(Alpha=opacity, Red=Slider(84, range=0..250), Green=Slider(148, range=0..250), Blue=Slider(191, range=0..250))
custom_preview_6 = CustomPreview(Geometry=extrude, Material=colour_rgb)

# ---- group: Tower 1: Coca-Cola Tower / Slab
slab_thickness = Slider(0.5, range=0..1)
boundary_surfaces = BoundarySurfaces(Edges=move_4.Geometry)
unit_z_3 = UnitZ(Factor=slab_thickness)
extrude_2 = Extrude(Base=boundary_surfaces, Direction=unit_z_3)
colour_picker_4 = ColourPicker(PickedColour=RGB(163, 175, 209))

# ---- group: Tower 1: Coca-Cola Tower / Lift Core
lift_shaft_size = Slider(1.5, range=1..2)
core_thickness = Slider(0.2, range=0..1)
vector_xyz_2 = VectorXYZ(XComponent=ghpython_script.a, YComponent=ghpython_script_2.a, ZComponent=expr("x+0.001", slab_thickness))  # -> Vector, Length
polygon_4 = Polygon(Plane=PlaneXY(0, 0, 0), Radius=lift_shaft_size, Segments=4, FilletRadius=0)  # -> Polygon, Length
move_5 = Move(Geometry=polygon_4.Polygon, Motion=vector_xyz_2.Vector)  # -> Geometry, Transform
bounds_4 = Bounds(Numbers=unit_z)
expression = Expression(X=lift_shaft_size, Y=core_thickness, Expression="(X + Y)/ X")
polygon_center = PolygonCenter(Polyline=move_5.Geometry)  # -> CenterV, CenterE, CenterA
deconstruct_domain_3 = DeconstructDomain(Domain=bounds_4)  # -> Start, End
scale_2 = Scale(Geometry=move_5.Geometry, Center=polygon_center.CenterV, Factor=expression)  # -> Geometry, Transform
lift_door_location = Slider(-1, range=-1..1)
lift_door_location_2 = Slider(-1, range=-1..1)
subtraction = Subtraction(A=deconstruct_domain_3.End, B=slab_thickness)
box_rectangle = BoxRectangle(Rectangle=scale_2.Geometry, Height=subtraction)
box_rectangle_2 = BoxRectangle(Rectangle=move_5.Geometry, Height=subtraction)
vector_xyz_3 = VectorXYZ(XComponent=lift_door_location, YComponent=lift_door_location_2, ZComponent=0)  # -> Vector, Length
solid_difference = SolidDifference(BrepsA=box_rectangle, BrepsB=box_rectangle_2)
move_6 = Move(Geometry=box_rectangle_2, Motion=vector_xyz_3.Vector)  # -> Geometry, Transform
solid_difference_2 = SolidDifference(BrepsA=solid_difference, BrepsB=move_6.Geometry)
opacity_2 = Slider(166, range=0..250)
colour_rgb_2 = ColourRGB(Alpha=opacity_2, Red=Slider(78, range=0..250), Green=Slider(144, range=0..250), Blue=Slider(225, range=0..250))
custom_preview_7 = CustomPreview(Geometry=solid_difference_2, Material=colour_rgb_2)

# ---- group: Tower 1: Coca-Cola Tower / Columns
distance_of_column_1_from_centre_of_slab = Slider(4.6, range=0..10)
distance_of_column_2_from_centre_of_slab = Slider(11.6, range=0..20)
no_of_floors_supported_by_column_2_x_1_n = Slider(34, range=0..150)  # "No. of Floors supported by Column 2 (x+1 No. of Floors)"
deconstruct = Deconstruct(Point=polygon_center.CenterA)  # -> XComponent, YComponent, ZComponent
addition = Addition(A=distance_of_column_1_from_centre_of_slab, B=deconstruct.XComponent)
addition_2 = Addition(A=distance_of_column_2_from_centre_of_slab, B=deconstruct.XComponent)
ghpython_script_3 = GhPythonScript(x=no_of_floors_supported_by_column_2_x_1_n, y=list_length)  # -> out, a
# ---------- ghpython_script_3: Python ----------
__author__ = "jeffw"
__version__ = "2022.01.04"

import rhinoscriptsyntax as rs

if x<y: #x is floor no columns need to reach; y is the last floor of the building
    a=x
else:
    a=y

print(a)
# ---------- end ghpython_script_3 ----------
radius_of_column_2 = Slider(0.1, range=0..2)
radius_of_column_1 = Slider(0.1, range=0..2)
vector_xyz_4 = VectorXYZ(XComponent=addition_2, YComponent=deconstruct.YComponent, ZComponent=deconstruct.ZComponent)  # -> Vector, Length
vector_xyz_5 = VectorXYZ(XComponent=addition, YComponent=deconstruct.YComponent, ZComponent=deconstruct.ZComponent)  # -> Vector, Length
list_item = ListItem(List=floor_height, Index=ghpython_script_3.a, Wrap=True)
subtraction_2 = Subtraction(A=deconstruct_domain.End, B=slab_thickness)
subtraction_3 = Subtraction(A=list_item, B=slab_thickness)
no_of_columns_per_ring_row = Slider(7, range=0..30)
angle_of_row_span = Slider(360, range=0..360)
column_2_middle_row = Cylinder(Base=vector_xyz_4.Vector, Radius=radius_of_column_2, Length=subtraction_3)
column_1_interior_row = Cylinder(Base=vector_xyz_5.Vector, Radius=radius_of_column_1, Length=subtraction_2)
polar_array = PolarArray(
    Geometry=column_1_interior_row,
    Plane=polygon_center.CenterE,
    Count=no_of_columns_per_ring_row,
    Angle=degrees(angle_of_row_span))  # -> Geometry, Transform
polar_array_2 = PolarArray(
    Geometry=column_2_middle_row,
    Plane=polygon_center.CenterE,
    Count=no_of_columns_per_ring_row,
    Angle=degrees(angle_of_row_span))  # -> Geometry, Transform
opacity_3 = Slider(206, range=0..250)
colour_rgb_3 = ColourRGB(Alpha=opacity_3, Red=Slider(8, range=0..250), Green=Slider(93, range=0..250), Blue=Slider(171, range=0..250))
custom_preview_8 = CustomPreview(Geometry=polar_array.Geometry, Material=colour_rgb_3)
custom_preview_9 = CustomPreview(Geometry=polar_array_2.Geometry, Material=colour_rgb_3)

# ---- group: Tower 1: Coca-Cola Tower / Usable Space
area = Area(Geometry=move_4.Geometry)  # -> Area, Centroid
mass_addition = MassAddition(Input=area.Area)  # -> Result, PartialResults
floor_surface_area_neglecting_column_and = Panel(mass_addition.Result)  # "Floor Surface Area (neglecting Column and Lift Core)"
area_of_floor_minus_lift_core = Expression(x=mass_addition.Result, y=lift_shaft_size, z=core_thickness, u=no_of_floors_excl_ground_floor, Expression="x-(y+z)²*(u)")
area_of_column_1 = Expression(x=radius_of_column_1, y=no_of_floors_excl_ground_floor, z=no_of_columns_per_ring_row, Expression="(π*x²)*(y+1)*z")
area_of_column_2 = Expression(x=radius_of_column_2, y=ghpython_script_3.a, z=no_of_columns_per_ring_row, Expression="(π*x²)*(y+1)*z")
subtraction_4 = Subtraction(A=area_of_floor_minus_lift_core, B=area_of_column_2, C=area_of_column_1)
usable_space_tower_1 = Panel(subtraction_4)

# ---- group: Tower 1: Coca-Cola Tower / Slab (continued)
trim_solid = TrimSolid(Shape=extrude_2, Cutters=box_rectangle_2)
custom_preview_10 = CustomPreview(Geometry=trim_solid, Material=colour_picker_4)

# ---- group: Tower 2: The Cup / Building Shape - Tower 2
radius_of_floor_prescaled_not_output = Slider(26, range=10..40)
no_of_floors_excl_ground_floor_2 = Slider(35, range=20..40)
series_5 = Series(Start=ground_floor_to_ceiling_height, Step=floor_to_floor_heights, Count=no_of_floors_excl_ground_floor_2)
circle = Circle(Plane=PlaneXY(0, 0, 0), Radius=radius_of_floor_prescaled_not_output)
circle_2 = Circle(Plane=PlaneXY(0, 0, 0), Radius=radius_of_floor_prescaled_not_output)
floor_height_2 = Panel(series_5)
unit_z_4 = UnitZ(Factor=series_5)
construct_point_3 = ConstructPoint(XCoordinate=0, YCoordinate=0, ZCoordinate=0)
unit_z_5 = UnitZ(Factor=0)
construct_point_4 = ConstructPoint(XCoordinate=0, YCoordinate=0, ZCoordinate=0)
bounds_5 = Bounds(Numbers=series_5)
move_7 = Move(Geometry=circle_2, Motion=unit_z_4)  # -> Geometry, Transform
remap_numbers_2 = RemapNumbers(Value=series_5, Source=bounds_5, Target=Domain(0, 1))  # -> Mapped, Clipped
move_8 = Move(Geometry=construct_point_3, Motion=unit_z_5)  # -> Geometry, Transform
move_9 = Move(Geometry=construct_point_4, Motion=unit_z_4)  # -> Geometry, Transform
merge_3 = Merge(Data1=circle, Data2=move_7.Geometry)  # -> flatten(Result)
graph_mapper_4 = GraphMapper(
    remap_numbers_2.Mapped,
    x0=0,
    x1=1,
    y0=0,
    y1=1,
    Ox=0.5611510873,
    Oy=0.4222221971,
    Px=0.992805779,
    Py=0.592592597,
    container_name="Parabola")
merge_4 = Merge(Data1=move_8.Geometry, Data2=move_9.Geometry)  # -> flatten(Result)
scale_3 = Scale(Geometry=merge_3, Center=merge_4, Factor=graph_mapper_4)  # -> Geometry, Transform
floor_size_scale_factor_2 = Panel(graph_mapper_4)
multiplication_2 = Multiplication(A=floor_size_scale_factor_2, B=radius_of_floor_prescaled_not_output)
actual_radius_at_each_floor_2 = Panel(multiplication_2)
bounds_6 = Bounds(Numbers=actual_radius_at_each_floor_2)
deconstruct_domain_4 = DeconstructDomain(Domain=bounds_6)  # -> Start, End

# ---- group: Tower 2: The Cup / Building Location
y_coordinate_2 = Slider(-40, range=-40..40)
x_coordinate_2 = Slider(-30, range=-30..30)
ghpython_script_4 = GhPythonScript(x=x_coordinate_2, y=deconstruct_domain_4.End)  # -> out, a; same code as ghpython_script
ghpython_script_5 = GhPythonScript(x=y_coordinate_2, y=deconstruct_domain_4.End)  # -> out, a; same code as ghpython_script_2
vector_xyz_6 = VectorXYZ(XComponent=ghpython_script_4.a, YComponent=ghpython_script_5.a, ZComponent=0)  # -> Vector, Length

# ---- group: Tower 2: The Cup / Building Shape - Tower 2 (continued)
move_10 = Move(Geometry=scale_3.Geometry, Motion=vector_xyz_6.Vector)  # -> Geometry, Transform

# ---- group: Tower 2: The Cup / Glass Panel
offset_distance_of_glass_panel = Slider(0.6, range=0..1)
loft_3 = Loft(
    Curves=move_10.Geometry,
    Options={Adjust=False, Closed=False, LoftEnds=0, LoftSimp=0, LoftType=0, Rebuild=10, Refit=0.01})
glass_panel_thickness_2 = Slider(0.02, range=0..0.02)
glass_panel_u_divisions = Slider(40, range=10..40)
glass_panel_v_divisions = Slider(30, range=10..30, expression="x*2")
offset_surface = OffsetSurface(Surface=loft_3, Distance=offset_distance_of_glass_panel, Retrim=True)
unit_x_2 = UnitX(Factor=glass_panel_thickness_2)
triangle_panels_b = TrianglePanelsB(Surface=offset_surface, UDivisions=glass_panel_u_divisions, VDivisions=glass_panel_v_divisions)
opacity_of_glass = Slider(65, range=0..250)
panel_frame = PanelFrame(Panel=triangle_panels_b, ScaleFactor=Slider(0.97, range=0.5..1))  # -> PanelFrame, Panel
extrude_3 = Extrude(Base=panel_frame.Panel, Direction=unit_x_2)
colour_rgb_4 = ColourRGB(Alpha=opacity_of_glass, Red=Slider(171, range=0..250), Green=Slider(194, range=0..250), Blue=Slider(233, range=0..250))
custom_preview_11 = CustomPreview(Geometry=extrude_3, Material=colour_rgb_4)
colour_picker_5 = ColourPicker(PickedColour=RGB(19, 26, 87))
custom_preview_12 = CustomPreview(Geometry=panel_frame.PanelFrame, Material=colour_picker_5)

# ---- group: Tower 2: The Cup / Diagrid Structure
no_of_floor_per_module = Slider(4, range=0..10)
expression_2 = Expression(x=no_of_floors_excl_ground_floor_2, y=no_of_floor_per_module, Expression="(x+1)/y")
radius_of_diagrid_structure_pipe = Slider(0.2, range=0..1)
diagrid_structure = DiagridStructure(Surface=loft_3, UDivisions=expression_2, VDivisions=Slider(8, range=5..15, expression="x*2"), Type=True)  # -> StructureLines, StructureNodes
pipe_4 = Pipe(Curve=diagrid_structure.StructureLines, Radius=radius_of_diagrid_structure_pipe, Caps=2)
colour_picker_6 = ColourPicker(PickedColour=RGB(13, 22, 84))
custom_preview_13 = CustomPreview(Geometry=pipe_4, Material=colour_picker_6)

# ---- group: Tower 2: The Cup / Facade
no_of_segment_2 = Slider(3, range=0..10)
facade_radius_2 = Slider(0.5, range=0..1)
divide_curve = DivideCurve(Curve=diagrid_structure.StructureLines, Count=10, Kinks=False)  # -> Points, Tangents, Parameters
polygon_5 = Polygon(Plane=divide_curve.Points, Radius=facade_radius_2, Segments=no_of_segment_2, FilletRadius=0)  # -> Polygon, Length
loft_4 = Loft(
    Curves=polygon_5.Polygon,
    Options={Adjust=False, Closed=False, LoftEnds=0, LoftSimp=0, LoftType=0, Rebuild=10, Refit=0.01})
colour_picker_7 = ColourPicker(PickedColour=RGB(242, 242, 242))
custom_preview_14 = CustomPreview(Geometry=loft_4, Material=colour_picker_7)

# ---- group: Tower 2: The Cup / Usable Space
area_2 = Area(Geometry=move_10.Geometry)  # -> Area, Centroid
mass_addition_2 = MassAddition(Input=area_2.Area)  # -> Result, PartialResults
total_floor_area_neglecting_lift_core = Panel(mass_addition_2.Result)

# ---- group: Tower 2: The Cup / Lift Core
lift_shaft_size_2 = Slider(1.5, range=1..2)
core_thickness_2 = Slider(0.2, range=0..1)
polygon_6 = Polygon(Plane=PlaneXY(0, 0, 0), Radius=lift_shaft_size_2, Segments=4, FilletRadius=0)  # -> Polygon, Length
bounds_7 = Bounds(Numbers=unit_z_4)
expression_3 = Expression(X=lift_shaft_size_2, Y=core_thickness_2, Expression="(X + Y)/ X")
deconstruct_domain_5 = DeconstructDomain(Domain=bounds_7)  # -> Start, End
lift_door_location_3 = Slider(1, range=-1..1)
lift_door_location_4 = Slider(1, range=-1..1)
vector_xyz_7 = VectorXYZ(XComponent=lift_door_location_3, YComponent=lift_door_location_4, ZComponent=0)  # -> Vector, Length
opacity_4 = Slider(166, range=0..250)
colour_rgb_5 = ColourRGB(Alpha=opacity_4, Red=Slider(78, range=0..250), Green=Slider(144, range=0..250), Blue=Slider(225, range=0..250))

# ---- group: Tower 2: The Cup / Usable Space (continued)
area_of_floors_minus_lift_core = Expression(
    x=mass_addition_2.Result,
    y=lift_shaft_size_2,
    z=core_thickness_2,
    u=no_of_floors_excl_ground_floor_2,
    Expression="x-(y+z)²*u")
usable_space_tower_2 = Panel(area_of_floors_minus_lift_core)

# ---- group: Total Usable Floor Space- Both Tower 1 and 2
addition_3 = Addition(A=usable_space_tower_1, B=usable_space_tower_2)
total_usable_space = Panel(addition_3)

# ---- group: Tower 2: The Cup / Slab
slab_thickness_2 = Slider(0.5, range=0..1)
boundary_surfaces_2 = BoundarySurfaces(Edges=move_10.Geometry)
unit_z_6 = UnitZ(Factor=slab_thickness_2)
extrude_4 = Extrude(Base=boundary_surfaces_2, Direction=unit_z_6)
colour_picker_8 = ColourPicker(PickedColour=RGB(163, 175, 209))

# ---- group: Tower 2: The Cup / Lift Core (continued)
vector_xyz_8 = VectorXYZ(XComponent=ghpython_script_4.a, YComponent=ghpython_script_5.a, ZComponent=expr("x+0.001", slab_thickness_2))  # -> Vector, Length
move_11 = Move(Geometry=polygon_6.Polygon, Motion=vector_xyz_8.Vector)  # -> Geometry, Transform
polygon_center_2 = PolygonCenter(Polyline=move_11.Geometry)  # -> CenterV, CenterE, CenterA
scale_4 = Scale(Geometry=move_11.Geometry, Center=polygon_center_2.CenterV, Factor=expression_3)  # -> Geometry, Transform
subtraction_5 = Subtraction(A=deconstruct_domain_5.End, B=slab_thickness_2)
box_rectangle_3 = BoxRectangle(Rectangle=move_11.Geometry, Height=subtraction_5)
box_rectangle_4 = BoxRectangle(Rectangle=scale_4.Geometry, Height=subtraction_5)
move_12 = Move(Geometry=box_rectangle_3, Motion=vector_xyz_7.Vector)  # -> Geometry, Transform
solid_difference_3 = SolidDifference(BrepsA=box_rectangle_4, BrepsB=box_rectangle_3)
solid_difference_4 = SolidDifference(BrepsA=solid_difference_3, BrepsB=move_12.Geometry)
custom_preview_15 = CustomPreview(Geometry=solid_difference_4, Material=colour_rgb_5)

# ---- group: Tower 2: The Cup / Slab (continued)
trim_solid_2 = TrimSolid(Shape=extrude_4, Cutters=box_rectangle_3)
custom_preview_16 = CustomPreview(Geometry=trim_solid_2, Material=colour_picker_8)
